# Grasshopper definition GH file qodo assignament 01.gh (Grasshopper 1.0.8)
# plug-ins: RhinoCodePluginGH

panel = Panel("C:\Users\agusc\Desktop\MPDA\AT-APY\Session 04\MPDA25-Session04\qodo\assignment01.py")
path = FilePath(panel)
panel_2 = Panel(path)
file = ReadFile(File=path, PerLineParse=False)
py3 = Python3Script(script=file, x_points=Slider(10, range=0..10), y_points=Slider(10, range=0..10))  # -> out, a, b, c, d, e, f, g, h, i; inputs x_points: Int32, y_points: Int32; unedited script template
pt = Point(py3.a)
pt_2 = Point(py3.b)
line = Line(py3.c)
pt_3 = Point(py3.d)
